vi "DAC Characterisation.gvi"   [LabVIEW NXG 5.0.0]
panel controls:
  "Start": bool
  "Stop": bool
  "Instrument Control Board": string
  "Refresh": bool
  "Error": error
  "Error_Type": error
  "Pause": bool
  "Resume": bool
  "IDs": string[]
  "DMM6500": string
  "Start Code": u16
  "Increment": u16 = 1
  "End Code": u16 = 65535
  "Logical Instrument": string = "DACA"
  "All Results": "All Results.gtype" = [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]
  "Export": bool
panel indicators:
  "Instrument Control Board Identity": string
  "Error Out": error
  "DMM6500 Identity": string
  "Characterisation": f64[]
  "Current Code": u16
  "Running": bool
types:
  "Result.gtype" = cluster{"Code": u16, "Timestamp": timestamp, "Voltage": f64, "Nominal": f64, "Difference": f64, "LSBs": f64}
  "All Results.gtype" = "Result.gtype"[]
  "All Notification Message Ids.gtype" = cluster{"Initialise": string, "Exit": string, "Error": string, "Result": string, "Done": string}
  "Event Data.gtype" = cluster{"Raiser Name": string, "Raiser Id": string}
uses:
  Hardware Abstraction Framework::Utilities::Setup Framework.gvi
  Hardware Abstraction Framework::Support::Messages::Dequeue Message.gvi
  NI::G Core::Error::Build Error Cluster.gvi
  Hardware Abstraction Framework::Support::Messages::Enqueue Message.gvi
  Hardware Abstraction Framework::Support::Helpers::Error Handling - Process Error.gvi
  Hardware Abstraction Framework::Support::Events::Raise Pause Event.gvi
  Hardware Abstraction Framework::Support::Events::Raise Resume Event.gvi
  Hardware Abstraction Framework::Utilities::Teardown Frameworkgvi.gvi
  Hardware Abstraction Framework::Common::WriteExecutable.gtype::Read Id.gvi
diagram:
  Obtain Notifier(element data type="ReadExecutable.gtype" constant, name="Results Notifier") -> (notifier out=w1)
  # Initialise the example before anything else
  # Listen for any stop event raised by the framework.  Can also raise a Stop event if the user presses Stop button.
  # The Notifications Queue is used to receive messages from the framework (typically results) but can also be used to send messages to control the processing loop following an event.
  sequence {
    frame 0 {
      call "Setup Framework.gvi"()
      $"Error Out" <- no error
      $"Instrument Control Board Identity" <- ""
      $"DMM6500 Identity" <- ""
      $Running <- FALSE
      Clear Data(reference in=reference to "Characterisation")
      Initialize Array(element="Result.gtype" {all zero or empty}, size=0) -> w2
      $"All Results" <- w2
    }
    frame 1 {
      w3 = "Hardware Abstraction Framework::Support::Resources.grsc::Events"
      Tag Read(ref in=w3) -> (Data=w4)
      Property Node(instance in=w4) -> ("Stop Event"=w5)
      w6 = "Hardware Abstraction Framework::Support::Resources.grsc::MessageQueues"
      Tag Read(ref in=w6) -> (Data=w7)
      Property Node(instance in=w7) -> ("Notifications"=w8)
    }
  }
  w9 = $Error
  # Main Processing loop.  Waits for messages to appear on the queue and then processes it.
  while {
    call "Dequeue Message.gvi"(Message Queue In=w8, Error In=w9) -> (Timed Out?=w10, Message Queue Out=w11, Message Id=w12, Message Data=w13, Error Out=w14)
    # Case options should include "All Notification Messages" as a minimum
    # Waits for next message. Queue is created with Initialise message.
    case (w12) {
      frame Default {
        w17 = "Application timed-out waiting for an action to be initiated.%s"
        w18 = "An unknown message - %s -was added to the notification queue"
        Select(s=w10, t=w17, f=w18) -> w19
        # An unknown message was added to the queue or a timeout occurred
        Format Into String(formatString=w19, w12) -> w20
        call "Build Error Cluster.gvi"(code=1, description=w20) -> (error out=w15)
        w16 = default
      }
      frame "Initialise" {
        # Queue a message to refresh the System Resources
        call "Enqueue Message.gvi"(Message Queue In=w11, Message Id="Refresh", Error In=w14) -> (Error Out=w15)
        w16 = default
      }
      frame "Refresh" {
        # Build the list of resources attached to the system and load their names into the UI combo box.  Select the first value so something is displayed.
        call "Get System Resources.gvi"(Error in=w14) -> (Resources=w21, Error out=w15)
        Array Index(array=w21) -> (out0[0]=w22)
        Property Node(instance in=reference to "Instrument Control Board", "Items"=w21, "Value"=w22)
        Property Node(instance in=reference to "DMM6500", "Items"=w21, "Value"=w22)
        w16 = default
      }
      frame "Stop" {
        w23 = "All Notification Message Ids.gtype" {"Initialise"="Initialise", "Exit"="Exit", "Error"="Error", "Result"="Result", "Done"="Done"}
        # Stop processing any more messages.
        Property Node(instance in=w23) -> ("Exit"=w24)
        call "Enqueue Message.gvi"(Message Queue In=w11, Message Id=w24, Error In=w14) -> (Error Out=w15)
        w16 = default
      }
      frame "Step Codes" {
        # Step Codes requested.  Process the command through the framework (sub-VI).  The Ids passed out will be used in processing the Result message.
        call "Build Characterisation Executables.gvi"(Start Code=$"Start Code", Increment=$Increment, End Code=$"End Code", Instrument Control Board=$"Instrument Control Board", DMM6500=$DMM6500, Logical Instrument=$"Logical Instrument", Error in=w14) -> (ExecutableProcessor=w25, IDs=w26, Error out=w27)
        call "Start Stepping.gvi"(ExecutableProcessor=w25, Results Notifier=w1, Error in=w27) -> (Error out=w15)
        $IDs <- w26
        $"Current Code" <- $"Start Code"
        Initialize Array(element="Result.gtype" {all zero or empty}, size=0) -> w28
        $"All Results" <- w28
        w16 = default
      }
      frame "Exit" {
        Variant To Data(type=no error, variant=w13) -> (data=w29, error out=w30)
        case (w30) {
          frame Error, Default {
            w15 = w14
          }
          frame No Error {
            # If exiting because of error, pass it on for display
            w15 = w29
          }
        }
        $Running <- FALSE
        w16 = TRUE
      }
      frame "Error" {
        # Handle an error.  Here nothing is done, but it could be logged as an example
        Variant To Data(type=$Error_Type, variant=w13) -> (data=w15)
        w16 = default
      }
      frame "Done" {
        $Running <- FALSE
        w15 = w14
        w16 = default
      }
    }
    call "Error Handling - Process Error.gvi"(Error to Process=w15, Exit on Error?=TRUE)
    stop if w16
  }
  Register For Events("Stop"=w5) -> (event registration refnum out=w31)
  # Event loop: loops until Stop pressed or a Stop event raised.
  # Handles UI events by sending messages to the processing loop.
  while {
    event (dynamic events = w31) {
      on "Stop" Value changed; "Window" Close {
        Property Node(instance in="Event Data.gtype" {all zero or empty}, "Raiser Name"="Waveform Measurement") -> (instance out=w34)
        # Stop button pressed. Raise Stop Event to halt further processing.
        Generate User Event(event data=w34, priority="high priority", user event=w5) -> (error out=w33)
        w32 = default
      }
      on dynamic event 0 {
        call "Enqueue Message.gvi"(Priority?=TRUE, Message Queue In=w8, Message Id="Stop") -> (Error Out=w33)
        # Stop event occurred.  Notify Main Processing Loop
        w32 = TRUE
      }
      on "Refresh" Value changed {
        # Refresh button pressed.  Notify Main Processing loop to rebuild resources
        call "Enqueue Message.gvi"(Message Queue In=w8, Message Id="Refresh") -> (Error Out=w33)
        w32 = default
      }
      on "Start" Value changed {
        $Running <- TRUE
        # Start button pressed.  Notify Main Processing Loop to step through the voltage range
        call "Enqueue Message.gvi"(Message Queue In=w8, Message Id="Step Codes") -> (Error Out=w33)
        w32 = default
      }
      on "Pause" Value changed {
        # Pause event occurred.  Notify Executable Processor
        call "Raise Pause Event.gvi"(Send Pause?=TRUE, Raiser Name="Waveform Measurement") -> (Error Out=w33)
        w32 = default
      }
      on "Resume" Value changed {
        # Resume event occurred.  Notify Executable Processor
        call "Raise Resume Event.gvi"(Send Resume?=TRUE, Raiser Name="Waveform Measurement") -> (Error Out=w33)
        w32 = default
      }
      on "Export" Value changed {
        call "ExportToCSV.gvi"(All Results=$"All Results", Panel Reference=reference to unnamed native front panel) -> (Error Out=w33)
        w32 = default
      }
    }
    call "Error Handling - Process Error.gvi"(Error to Process=w33, Exit on Error?=FALSE)
    stop if w32
  }
  # Finally, deregister from events
  Unregister For Events(error in=w33, event registration refnum=w31) -> (error out=w35)
  Merge Errors(w35, w15) -> (error out=w36)
  Release Notifier(error in (no error)=w36, notifier=w1) -> (error out=w37)
  call "Teardown Frameworkgvi.gvi"(Error In=w37) -> (Error Out=w38)
  # When Processing Errors,
  # the Main Loop will Exit as
  # the app may be in an unknown state.  The Event Loop will send an Error message to the Message Handler.
  #
  # Reset the framework to release all
  # event and notification references.
  $"Error Out" <- w38
  # Results Processing Loop.  All UI updates should be performed here.
  # Results will be notified to the Test App so they can
  # be processed.  This example uses a Continuous Executable
  # Director which blocks the Main Processing loop from processing results until it completes (which is never!) Notification of results by the framework allows them to be displayed on the UI.
  while {
    Wait On Notification(notifier=w1) -> (error out=w39, notification=w40)
    case (w39) {
      frame Error, Default {
        w41 = w39
      }
      frame No Error {
        call "Read Id.gvi"(Executable in=w40, Error in=w39) -> (Executable out=w42, Id=w43, Error out=w44)
        Array Index(array=$IDs) -> (out0[0]=w45)
        Is Equal(x=w43, y=w45) -> w46
        case (w46) {
          frame False, Default {
            # Do nothing
          }
          frame True {
            call "Parse Identity from Result.gvi"(Read Executable In=w42, Error In=w44) -> (Result=w47)
            $"Instrument Control Board Identity" <- w47
          }
        }
        Array Index(array=$IDs) -> (out0[1]=w48)
        Is Equal(x=w43, y=w48) -> w49
        case (w49) {
          frame False, Default {
            # Do nothing
          }
          frame True {
            call "Parse Identity from Result.gvi"(Read Executable In=w42, Error In=w44) -> (Result=w50)
            $"DMM6500 Identity" <- w50
          }
        }
        Array Index(array=$IDs) -> (out0[2]=w51)
        Is Equal(x=w43, y=w51) -> w52
        case (w52) {
          frame True {
            call "Parse Reading from Result.gvi"(Read Executable In=w42, Error In=w44) -> (Voltage Result=w53, Timestamp=w54, Error Out=w55)
            $Characterisation <- w53
            Array Index(array=w53) -> (out0[0]=w56)
            call "Build Results.gvi"(Voltage=w56, Timestamp=w54, Current Code=$"Current Code", Error In=w55) -> (Result=w57)
            Insert Into Array(inArray=$"All Results", new=w57) -> w58
            $"All Results" <- w58
            Add($"Current Code", $Increment) -> w59
            $"Current Code" <- w59
          }
          frame False {
            # Do nothing
          }
        }
        w41 = default
      }
    }
    stop if w41
  }
