vi "ConvertResultsToArray.gvi"   [LabVIEW NXG 5.0.0]
inputs:
  "All Results": "All Results.gtype"
  "Error In": error
outputs:
  "ResultsAsStrings": string[]
  "Error Out": error
types:
  T1 = cluster{"Code": u16, "Timestamp": timestamp, "Voltage": f64, "Nominal": f64}
  "All Results.gtype" = T1[]
diagram:
  case ($"Error In") {
    frame Error, Default {
      w1 = $"Error In"
    }
    frame No Error {
      Initialize Array(element="CODE,TIME,VOLTS,NOMINAL", size=1) -> w2
      s1 = w2  # shift register
      for {
        w3 = each element of $"All Results"
        Property Node(instance in=w3) -> ("Code"=w4, "Timestamp"=w5, "Voltage"=w6, "Nominal"=w7)
        Number To Decimal String(number=w4) -> (decimal integer string=w8)
        Number To Fractional String(number=w6) -> (F-format string=w9)
        Number To Fractional String(number=w7) -> (F-format string=w10)
        Format Date Time String(time stamp=w5) -> (date/time string=w11)
        Concatenate Strings(w8, ",", w11, ",", w9, ",", w10) -> w12
        Insert Into Array(inArray=s1, new=w12) -> w13
        next s1 = w13
      }
      $ResultsAsStrings <- s1
      w1 = $"Error In"
    }
  }
  $"Error Out" <- w1
