vi "ExportToCSV.gvi"   [LabVIEW NXG 5.0.0]
inputs:
  "All Results": "All Results.gtype"
  "Error In": error
  "Panel Reference": "FrontPanelCanvas reference"
outputs:
  "Error Out": error
types:
  T1 = cluster{"Code": u16, "Timestamp": timestamp, "Voltage": f64, "Nominal": f64}
  "All Results.gtype" = T1[]
diagram:
  Array Size(array=$"All Results") -> (size(s)=w1)
  Is Equal To 0(x=w1) -> w2
  case (w2) {
    frame False, Default {
      case ($"Error In") {
        frame Error, Default {
          w3 = $"Error In"
        }
        frame No Error {
          Set Busy(reference in=$"Panel Reference", error in=$"Error In") -> (error out=w4)
          call "ConvertResultsToArray.gvi"(All Results=$"All Results", Error In=w4) -> (ResultsAsStrings=w5, Error Out=w6)
          Write To Text File(error in=w6, prompt (Choose or enter file path)="Create a new file or append to an existing one", text=w5) -> (cancelled=w7, error out=w8)
          case (w7) {
            frame False, Default {
              w9 = w8
            }
            frame True {
              w9 = no error
            }
          }
          Unset Busy(reference in=$"Panel Reference", error in=w9) -> (error out=w3)
        }
      }
    }
    frame True {
      One Button Dialog(message="No results to save")
      w3 = $"Error In"
    }
  }
  $"Error Out" <- w3
