vi "ADC Characterisation.gvi"   [LabVIEW NXG 5.0.0]
panel controls:
  "Start": bool
  "Stop": bool
  "HMC8043": string
  "Refresh": bool
  "Error": error
  "Error_Type": error
  "Pause": bool
  "Resume": bool
  "IDs": string[]
  "DMM6500": string
  "Start Volts": f32
  "Increment": f32
  "End Volts": f32
  "Instrument Control Board": string
  "Logical Instrument": string = "ADC1"
  "ADC Result": "ADCResult.gtype"
  "Button": bool
panel indicators:
  "HMC8043 Identity": string
  "Error Out": error
  "Measurements": waveform<f64>[]
  "DMM6500 Identity": string
  "ICB Identity": string
  "Running": bool
  "Current Volts": f64
types:
  "ADCResult.gtype" = cluster{"PSU Output Volts": f64, "ADC Read Volts": f64, "DMM Measured Volts": f64, "Difference": f64, "Timestamp": timestamp, "LSBs": f64}
  "All Notification Message Ids.gtype" = cluster{"Initialise": string, "Exit": string, "Error": string, "Result": string, "Done": string}
  "Event Data.gtype" = cluster{"Raiser Name": string, "Raiser Id": string}
uses:
  Hardware Abstraction Framework::Utilities::Setup Framework.gvi
  Hardware Abstraction Framework::Support::Messages::Dequeue Message.gvi
  NI::G Core::Error::Build Error Cluster.gvi
  Hardware Abstraction Framework::Support::Messages::Enqueue Message.gvi
  Hardware Abstraction Framework::Support::Helpers::Error Handling - Process Error.gvi
  Hardware Abstraction Framework::Support::Events::Raise Pause Event.gvi
  Hardware Abstraction Framework::Support::Events::Raise Resume Event.gvi
  Hardware Abstraction Framework::Utilities::Teardown Frameworkgvi.gvi
  Hardware Abstraction Framework::Common::WriteExecutable.gtype::Read Id.gvi
diagram:
  # Results will be notified to the Test App so they can
  # be processed.  This example uses a Continuous Executable
  # Director which blocks the Main Processing loop from processing results until it completes (which is never!) Notification of results by the framework allows them to be displayed on the UI.
  Obtain Notifier(element data type="ReadExecutable.gtype" constant, name="Results Notifier") -> (notifier out=w1)
  # Initialise the example before anything else
  # Listen for any stop event raised by the framework.  Can also raise a Stop event if the user presses Stop button.
  # The Notifications Queue is used to receive messages from the framework (typically results) but can also be used to send messages to control the processing loop following an event.
  sequence {
    frame 0 {
      call "Setup Framework.gvi"()
      $"Error Out" <- no error
      $"HMC8043 Identity" <- ""
      $"DMM6500 Identity" <- ""
      Clear Data(reference in=reference to "Measurements")
    }
    frame 1 {
      w2 = "Hardware Abstraction Framework::Support::Resources.grsc::Events"
      Tag Read(ref in=w2) -> (Data=w3)
      Property Node(instance in=w3) -> ("Stop Event"=w4)
      w5 = "Hardware Abstraction Framework::Support::Resources.grsc::MessageQueues"
      Tag Read(ref in=w5) -> (Data=w6)
      Property Node(instance in=w6) -> ("Notifications"=w7)
    }
  }
  w8 = $Error
  # Main Processing loop.  Waits for messages to appear on the queue and then processes it.
  while {
    call "Dequeue Message.gvi"(Message Queue In=w7, Error In=w8) -> (Timed Out?=w9, Message Queue Out=w10, Message Id=w11, Message Data=w12, Error Out=w13)
    # Case options should include "All Notification Messages" as a minimum
    # Waits for next message. Queue is created with Initialise message.
    case (w11) {
      frame Default {
        w16 = "Application timed-out waiting for an action to be initiated.%s"
        w17 = "An unknown message - %s -was added to the notification queue"
        Select(s=w9, t=w16, f=w17) -> w18
        # An unknown message was added to the queue or a timeout occurred
        Format Into String(formatString=w18, w11) -> w19
        call "Build Error Cluster.gvi"(code=1, description=w19) -> (error out=w14)
        w15 = default
      }
      frame "Initialise" {
        # Queue a message to refresh the System Resources
        call "Enqueue Message.gvi"(Message Queue In=w10, Message Id="Refresh", Error In=w13) -> (Error Out=w14)
        w15 = default
      }
      frame "Refresh" {
        call "Get System Resources.gvi"(Error in=w13) -> (Resources=w20, Error out=w14)
        Array Index(array=w20) -> (out0[0]=w21)
        Property Node(instance in=reference to "HMC8043", "Items"=w20, "Value"=w21)
        # Build the list of resources attached to the system and load their names into the UI combo box.  Select the first value so something is displayed.
        Property Node(instance in=reference to "DMM6500", "Items"=w20, "Value"=w21)
        w15 = default
      }
      frame "Stop" {
        w22 = "All Notification Message Ids.gtype" {"Initialise"="Initialise", "Exit"="Exit", "Error"="Error", "Result"="Result", "Done"="Done"}
        # Stop processing any more messages.
        Property Node(instance in=w22) -> ("Exit"=w23)
        call "Enqueue Message.gvi"(Message Queue In=w10, Message Id=w23, Error In=w13) -> (Error Out=w14)
        w15 = default
      }
      frame "Step Voltage" {
        # Step Voltage requested.  Process the command through the framework (sub-VI).  The Ids passed out will be used in processing the Result message.
        call "Build Stepping Executables.gvi"(Increment=$Increment, End Volts=$"End Volts", Generate Instrument Name=$HMC8043, Measure Instrument Name=$DMM6500, Start Volts=$"Start Volts", Error in=w13) -> (ExecutableProcessor=w24, IDs=w25, Error out=w26)
        call "Start Stepping.gvi"(ExecutableProcessor=w24, Results Notifier=w1, Error in=w26) -> (Error out=w14)
        $IDs <- w25
        w15 = default
      }
      frame "Exit" {
        Variant To Data(type=no error, variant=w12) -> (data=w27, error out=w28)
        case (w28) {
          frame Error, Default {
            w14 = w13
          }
          frame No Error {
            # If exiting because of error, pass it on for display
            w14 = w27
          }
        }
        w15 = TRUE
      }
      frame "Error" {
        # Handle an error.  Here nothing is done, but it could be logged as an example
        Variant To Data(type=$Error_Type, variant=w12) -> (data=w14)
        w15 = default
      }
      frame "Done" {
        # Do nothing
        w14 = w13
        w15 = default
      }
    }
    call "Error Handling - Process Error.gvi"(Error to Process=w14, Exit on Error?=TRUE)
    stop if w15
  }
  Register For Events("Stop"=w4) -> (event registration refnum out=w29)
  # Event loop: loops until Stop pressed or a Stop event raised.
  # Handles UI events by sending messages to the processing loop.
  while {
    event (dynamic events = w29) {
      on "Stop" Value changed; "Window" Close {
        Property Node(instance in="Event Data.gtype" {all zero or empty}, "Raiser Name"="Waveform Measurement") -> (instance out=w32)
        # Stop button pressed. Raise Stop Event to halt further processing.
        Generate User Event(event data=w32, priority="high priority", user event=w4) -> (error out=w31)
        w30 = default
      }
      on dynamic event 0 {
        call "Enqueue Message.gvi"(Priority?=TRUE, Message Queue In=w7, Message Id="Stop") -> (Error Out=w31)
        # Stop event occurred.  Notify Main Processing Loop
        w30 = TRUE
      }
      on "Refresh" Value changed {
        # Refresh button pressed.  Notify Main Processing loop to rebuild resources
        call "Enqueue Message.gvi"(Message Queue In=w7, Message Id="Refresh") -> (Error Out=w31)
        w30 = default
      }
      on "Start" Value changed {
        # Start button pressed.  Notify Main Processing Loop to step through the voltage range
        call "Enqueue Message.gvi"(Message Queue In=w7, Message Id="Step Voltage") -> (Error Out=w31)
        w30 = default
      }
      on "Pause" Value changed {
        # Pause event occurred.  Notify Executable Processor
        call "Raise Pause Event.gvi"(Send Pause?=TRUE, Raiser Name="Waveform Measurement") -> (Error Out=w31)
        w30 = default
      }
      on "Resume" Value changed {
        # Resume event occurred.  Notify Executable Processor
        call "Raise Resume Event.gvi"(Send Resume?=TRUE, Raiser Name="Waveform Measurement") -> (Error Out=w31)
        w30 = default
      }
    }
    call "Error Handling - Process Error.gvi"(Error to Process=w31, Exit on Error?=FALSE)
    stop if w30
  }
  # Finally, deregister from events
  Unregister For Events(error in=w31, event registration refnum=w29) -> (error out=w33)
  Merge Errors(w33, w14) -> (error out=w34)
  Release Notifier(error in (no error)=w34, notifier=w1) -> (error out=w35)
  call "Teardown Frameworkgvi.gvi"(Error In=w35) -> (Error Out=w36)
  # When Processing Errors,
  # the Main Loop will Exit as
  # the app may be in an unknown state.  The Event Loop will send an Error message to the Message Handler.
  #
  # Reset the framework to release all
  # event and notification references.
  $"Error Out" <- w36
  # Results Processing Loop.  All UI updates should be performed here.
  while {
    Wait On Notification(notifier=w1) -> (error out=w37, notification=w38)
    case (w37) {
      frame Error, Default {
        w39 = w37
      }
      frame No Error {
        call "Read Id.gvi"(Executable in=w38, Error in=w37) -> (Executable out=w40, Id=w41, Error out=w42)
        Array Index(array=$IDs) -> (out0[0]=w43)
        Is Equal(x=w41, y=w43) -> w44
        case (w44) {
          frame False, Default {
            # Do nothing
          }
          frame True {
            call "Parse Identity from Result.gvi"(Read Executable In=w40, Error In=w42) -> (Result=w45)
            $"HMC8043 Identity" <- w45
          }
        }
        Array Index(array=$IDs) -> (out0[1]=w46)
        Is Equal(x=w41, y=w46) -> w47
        case (w47) {
          frame False, Default {
            # Do nothing
          }
          frame True {
            call "Parse Identity from Result.gvi"(Read Executable In=w40, Error In=w42) -> (Result=w48)
            $"DMM6500 Identity" <- w48
          }
        }
        Array Index(array=$IDs) -> (out0[2]=w49)
        Is Equal(x=w41, y=w49) -> w50
        case (w50) {
          frame True {
            call "Parse Waveform from Result.gvi"(Read Executable In=w40, Error In=w42) -> (Waveform=w51)
            $Measurements <- w51
          }
          frame False {
            # Do nothing
          }
        }
        w39 = default
      }
    }
    stop if w39
  }
