vi "Build ADC Characterisation Executables.gvi"   [LabVIEW NXG 5.0.0]
inputs:
  "HMC8043 Name": string  # The name of the instrument whose Id shoudl be fetched.
  "DMM6500 Name": string  # The name of the instrument whose Id shoudl be fetched.
  "Start Volts": f32
  "Error in": error
  "Increment": f32
  "End Volts": f32
  "ICB Name": string
  "Logical Instrument": string
outputs:
  "ExecutableProcessor": "ExecutableProcessor.gtype"
  "IDs": string[]
  "Error out": error
uses:
  Hardware Abstraction Framework::Common::ExecutableProcessor.gtype::Add Director.gvi
diagram:
  case ($"Error in") {
    frame Error, Default {
      w1 = $"Error in"
      w2 = default
    }
    frame No Error {
      call "Get Instrument Identities.gvi"(HMC8043 Name=$"HMC8043 Name", DMM6500 Name=$"DMM6500 Name", ICB Name=$"ICB Name", Error in=$"Error in") -> (ExecutableProcessor=w3, ADC Drivers=w4, IDs=w5, Error out=w6)
      Property Node(instance in=w4) -> ("HMC8043 Driver"=w7, "DMM6500 Driver"=w8, instance out=w9)
      call "Configure DMM6500 for Accuracy.gvi"(Driver=w8, Error In=w6) -> (ExecutableDirector=w10, Error Out=w11)
      call "Add Director.gvi"(ExecutableProcessor in=w3, ExecutableDirector=w10, Error in=w11) -> (ExecutableProcessor out=w12, Error out=w13)
      call "Configure HMC8043.gvi"(HMC8043 Driver=w7, Channel=1, Error In=w13) -> (ExecutableDirector=w14, Error Out=w15)
      call "Add Director.gvi"(ExecutableProcessor in=w12, ExecutableDirector=w14, Error in=w15) -> (ExecutableProcessor out=w16, Error out=w17)
      call "Setup ADC Characterisation.gvi"(Increment=$Increment, End Volts=$"End Volts", ADC Drivers=w9, Logical Instrument=$"Logical Instrument", Start Volts=$"Start Volts", Error in=w17) -> (ExecutableDirector=w18, DMM MEAS Id=w19, ADC MEAS Id=w20, Error Out=w21)
      call "Add Director.gvi"(ExecutableProcessor in=w16, ExecutableDirector=w18, Error in=w21) -> (ExecutableProcessor out=w2, Error out=w1)
      Insert Into Array(inArray=w5, new=w19, new=w20) -> w22
      $IDs <- w22
    }
  }
  $ExecutableProcessor <- w2
  $"Error out" <- w1
