vi "Export ADC Results to CSV.gvi"   [LabVIEW NXG 5.0.0]
inputs:
  "Panel Reference": "FrontPanelCanvas reference"
  "All ADC Results": "All ADCResults.gtype"
  "Error In": error
outputs:
  "Error Out": error
types:
  "ADCResult.gtype" = cluster{"PSU Output Volts": f32, "ADC Read Volts": f64, "DMM Measured Volts": f64, "Difference": f64, "Timestamp": timestamp, "LSBs": f64}
  "All ADCResults.gtype" = "ADCResult.gtype"[]
diagram:
  Array Size(array=$"All ADC Results") -> (size(s)=w1)
  Is Equal To 0(x=w1) -> w2
  case (w2) {
    frame False, Default {
      case ($"Error In") {
        frame Error, Default {
          w3 = $"Error In"
        }
        frame No Error {
          Set Busy(reference in=$"Panel Reference", error in=$"Error In") -> (reference out=w4, error out=w5)
          call "Convert ADC Results to Array.gvi"(All ADC Results=$"All ADC Results", Error In=w5) -> (Error Out=w6)
          Write To Text File(error in=w6, text="Create a new file or append to an existing one") -> (cancelled=w7, error out=w8)
          case (w7) {
            frame False, Default {
              w9 = w8
            }
            frame True {
              w9 = no error
            }
          }
          Unset Busy(reference in=w4, error in=w9) -> (error out=w3)
        }
      }
    }
    frame True {
      One Button Dialog(message="No results to save")
      w3 = $"Error In"
    }
  }
  $"Error Out" <- w3
