vi "Setup ADC Characterisation.gvi"   [LabVIEW NXG 5.0.0]
inputs:
  "ADC Drivers": "ADC Drivers.gtype"
  "Logical Instrument": string = "ADC1"
  "Start Volts": f32
  "Error in": error
  "Increment": f32
  "End Volts": f32
outputs:
  "ExecutableDirector": "ExecutableDirector.gtype"  # Configured Executable Director (execute once) capable of running the necessary commands.
  "DMM MEAS Id": string  # The ID of the the *IDN? Executable which will be used to identify an incoming result.
  "Error Out": error
  "ADC MEAS Id": string  # The ID of the the *IDN? Executable which will be used to identify an incoming result.
types:
  "ADC Drivers.gtype" = cluster{"HMC8043 Driver": "Driver.gtype", "DMM6500 Driver": "Driver.gtype", "ICB Driver": "Driver.gtype"}
uses:
  Hardware Abstraction Framework::Common::WriteExecutable.gtype::Write Driver.gvi
  Hardware Abstraction Framework::Command::SCPI Generic::User Defined Read.gtype::Write Command to Execute.gvi
  Hardware Abstraction Framework::Common::WriteExecutable.gtype::Read Id.gvi
  Hardware Abstraction Framework::Command::SCPI Acquire::Measure.gtype::Configure.gvi
  Hardware Abstraction Framework::Support::Helpers::Parameter Builder.gvi
  Hardware Abstraction Framework::Common::WriteExecutable.gtype::Write Parameters.gvi
  Hardware Abstraction Framework::Command::SCPI Generate::Voltage.gtype::Write Volts.gvi
  Hardware Abstraction Framework::Command::SCPI Generate::Voltage.gtype::Write Increment.gvi
  Hardware Abstraction Framework::Common::RepeatingDirector.gtype::Write Times Repeat.gvi
  Hardware Abstraction Framework::Common::ExecutableDirector.gtype::Write Wait Time.gvi
  Hardware Abstraction Framework::Common::ExecutableDirector.gtype::Add Executable.gvi
diagram:
  Property Node(instance in=$"ADC Drivers") -> ("HMC8043 Driver"=w1, "DMM6500 Driver"=w2, "ICB Driver"=w3)
  case ($"Error in") {
    frame Error, Default {
      w4 = $"Error in"
    }
    frame No Error {
      call "Write Driver.gvi"(Executable in="User Defined Read.gtype" constant, Driver In=w3, Error in=$"Error in") -> (Executable out=w5, Error out=w6)
      Concatenate Strings("TEST:", $"Logical Instrument", " CONT,16,1") -> w7
      call "Write Command to Execute.gvi"(User Defined Read in=w5, Command to Execute=w7, Error in=w6) -> (User Defined Read out=w8, Error out=w9)
      call "Read Id.gvi"(Executable in=w8, Error in=w9) -> (Executable out=w10, Id=w11, Error out=w12)
      call "Write Driver.gvi"(Executable in="Measure.gtype" constant, Driver In=w2, Error in=$"Error in") -> (Executable out=w13, Error out=w14)
      call "Configure.gvi"(Measure in=w13, Function="DC Voltage", Buffer Name="mybuffer", Error in=w14) -> (Measure out=w15, Error out=w16)
      Build Array("READING", "TSTAMP") -> w17
      call "Parameter Builder.gvi"(Names=w17) -> (Parameters=w18)
      call "Write Parameters.gvi"(Executable in=w15, Parameters=w18, Error in=w16) -> (Executable out=w19, Error out=w20)
      call "Read Id.gvi"(Executable in=w19, Error in=w20) -> (Executable out=w21, Id=w22, Error out=w23)
      call "Write Volts.gvi"(Voltage in="Voltage.gtype" constant, Volts=$"Start Volts", Error in=$"Error in") -> (Voltage out=w24, Error out=w25)
      call "Write Increment.gvi"(Voltage in=w24, Increment=$Increment, Error in=w25) -> (Voltage out=w26, Error out=w27)
      call "Write Driver.gvi"(Executable in=w26, Driver In=w1, Error in=w27) -> (Executable out=w28, Error out=w29)
      # Calc stepping count
      Subtract(x=$"End Volts", y=$"Start Volts") -> w30
      Divide(x=w30, y=$Increment) -> w31
      Round Toward Positive Infinity(x=w31) -> w32
      call "Write Times Repeat.gvi"(RepeatingDirector in="RepeatingDirector.gtype" constant, Times Repeat=w32) -> (RepeatingDirector out=w33, Error out=w34)
      call "Write Wait Time.gvi"(ExecutableDirector in=w33, Wait Time=10, Error in=w34) -> (ExecutableDirector out=w35, Error out=w36)
      Merge Errors(w36, w29, w23, w12) -> (error out=w37)
      call "Add Executable.gvi"(ExecutableDirector in=w35, Executable=w28, Error in=w37) -> (ExecutableDirector out=w38, Error out=w39)
      call "Add Executable.gvi"(ExecutableDirector in=w38, Executable=w21, Error in=w39) -> (ExecutableDirector out=w40, Error out=w41)
      call "Add Executable.gvi"(ExecutableDirector in=w40, Executable=w10, Error in=w41) -> (ExecutableDirector out=w42, Error out=w4)
      $ExecutableDirector <- w42
      $"DMM MEAS Id" <- w22
      $"ADC MEAS Id" <- w11
    }
  }
  $"Error Out" <- w4
