vi "Setup Measure Executable.gvi"   [LabVIEW NXG 5.0.0]
inputs:
  "Driver": "Driver.gtype"  # Driver to obtain Id for.
  "Error In": error
  "Function": u16
outputs:
  "Error Out": error
  "ExecutableDirector": "ExecutableDirector.gtype"  # Configured Executable Director (execute once) capable of running the necessary commands.
  "MEAS Id": string  # The ID of the the *IDN? Executable which will be used to identify an incoming result.
uses:
  Hardware Abstraction Framework::Common::WriteExecutable.gtype::Write Driver.gvi
  Hardware Abstraction Framework::Command::SCPI Acquire::Measure.gtype::Configure.gvi
  Hardware Abstraction Framework::Common::WriteExecutable.gtype::Read Id.gvi
  Hardware Abstraction Framework::Common::ExecutableDirector.gtype::Add Executable.gvi
diagram:
  # Adds the Driver to the :MEAS? command and add to an Executable Director.  The Id of the :MEAS? command is used in processing results: each result notified will contain an Id so that the user can correlate results.
  case ($"Error In") {
    frame Error, Default {
      w1 = $"Error In"
    }
    frame No Error {
      call "Write Driver.gvi"(Executable in="Measure.gtype" constant, Driver In=$Driver, Error in=$"Error In") -> (Executable out=w2, Error out=w3)
      call "Configure.gvi"(Measure in=w2, Function=$Function, Error in=w3) -> (Measure out=w4, Error out=w5)
      call "Read Id.gvi"(Executable in=w4, Error in=w5) -> (Executable out=w6, Id=w7, Error out=w8)
      call "Add Executable.gvi"(ExecutableDirector in="ExecutableDirector.gtype" constant, Executable=w6, Error in=w8) -> (ExecutableDirector out=w9, Error out=w1)
      $ExecutableDirector <- w9
      $"MEAS Id" <- w7
    }
  }
  $"Error Out" <- w1
