vi "Waveform Measurement.gvi"   [LabVIEW NXG 5.0.0]
panel controls:
  "Start": bool
  "Stop": bool
  "Instruments": string
  "Refresh": bool
  "Error": error
  "Error_Type": error
  "Function": T1 = "[As Set]"  # The type of measurement to be measured, e.g voltage, current etc. If not specified, the current function is used (As Set.)
  "Pause": bool
  "Resume": bool
panel indicators:
  "Identity": string
  "Error Out": error
  "Measurements": waveform<f64>[]
types:
  T1 = enum{"[As Set]", "DC Voltage", "AC Voltage", "DC Current", "AC Current", "2-wire Resistance", "4-wire Resistance", "Diode", "Capacitance", "Temperature", "Continuity", "Frequency", "Period", "DC Voltage Ratio"}
  "All Notification Message Ids.gtype" = cluster{"Initialise": string, "Exit": string, "Error": string, "Result": string, "Done": string}
  "Event Data.gtype" = cluster{"Raiser Name": string, "Raiser Id": string}
  "All Internal Message Ids.gtype" = cluster{"Initialise": string, "Stop": string, "Done": string, "Exit": string, "Process": string, "Continue": string, "Pause": string, "Resume": string}
uses:
  Hardware Abstraction Framework::Utilities::Reset Framework.gvi
  Hardware Abstraction Framework::Support::Messages::Dequeue Message.gvi
  NI::G Core::Error::Build Error Cluster.gvi
  Hardware Abstraction Framework::Support::Messages::Enqueue Message.gvi
  Hardware Abstraction Framework::Common::WriteExecutable.gtype::Read Id.gvi
  Hardware Abstraction Framework::Support::Helpers::Error Handling - Process Error.gvi
diagram:
  # Initialise the example before anything else
  # Listen for any stop event raised by the framework.  Can also raise a Stop event if the user presses Stop button.
  sequence {
    frame 0 {
      call "Reset Framework.gvi"()
      $"Error Out" <- no error
      $Identity <- ""
      Clear Data(reference in=reference to "Measurements")
    }
    frame 1 {
      w1 = "Hardware Abstraction Framework::Support::Resources.grsc::Events"
      Tag Read(ref in=w1) -> (Data=w2)
      Property Node(instance in=w2) -> ("Stop Event"=w3)
      w4 = "Hardware Abstraction Framework::Support::Resources.grsc::MessageQueues"
      Tag Read(ref in=w4) -> (Data=w5)
      Property Node(instance in=w5) -> ("Notifications"=w6)
    }
  }
  # IDs will hold references that can be used to tie a Result message to the Executable that was processed - in this example, *IDN? and :MEAS:. There are different ways of doing this, but using a shift-register keeps the execution visible for the example.
  w7 = string[] []  # IDs
  # The Notifications Queue is used to receive messages from the framework (typically results) but can also be used to send messages to control the processing loop following an event.
  w8 = $Error
  # Main Processing loop.  Waits for messages to appear on the queue and then processes it.
  s1 = w7  # shift register
  while {
    call "Dequeue Message.gvi"(Message Queue In=w6, Error In=w8) -> (Timed Out?=w9, Message Queue Out=w10, Message Id=w11, Message Data=w12, Error Out=w13)
    # Case options should include "All Notification Messages" as a minimum
    # Waits for next message. Queue is created with Initialise message.
    case (w11) {
      frame Default {
        w17 = "Application timed-out waiting for an action to be initiated.%s"
        w18 = "An unknown message - %s -was added to the notification queue"
        Select(s=w9, t=w17, f=w18) -> w19
        # An unknown message was added to the queue or a timeout occurred
        Format Into String(formatString=w19, w11) -> w20
        call "Build Error Cluster.gvi"(code=1, description=w20) -> (error out=w14)
        w15 = default
        w16 = s1
      }
      frame "Initialise" {
        # Queue a message to refresh the System Resources
        call "Enqueue Message.gvi"(Message Queue In=w10, Message Id="Refresh", Error In=w13) -> (Error Out=w14)
        w15 = default
        w16 = s1
      }
      frame "Refresh" {
        # Build the list of resources attached to the system and load their names into the UI combo box.  Select the first value so something is displayed.
        call "Get System Resources.gvi"(Error in=w13) -> (Resources=w21, Error out=w14)
        Array Index(array=w21) -> (out0[0]=w22)
        Property Node(instance in=reference to "Instruments", "Items"=w21, "Value"=w22)
        w15 = default
        w16 = s1
      }
      frame "Stop" {
        w23 = "All Notification Message Ids.gtype" {"Initialise"="Initialise", "Exit"="Exit", "Error"="Error", "Result"="Result", "Done"="Done"}
        # Stop processing any more messages.
        Property Node(instance in=w23) -> ("Exit"=w24)
        call "Enqueue Message.gvi"(Message Queue In=w10, Message Id=w24, Error In=w13) -> (Error Out=w14)
        w15 = default
        w16 = s1
      }
      frame "Get Measure" {
        # Get Measure requested.  Process the command through the framework (sub-VI).  The Ids passed out will be used in processing the Result message.
        call "Start Measuring.gvi"(Instrument Name=$Instruments, Function=$Function, Error in=w13) -> (IDs=w16, Error out=w14)
        w15 = default
      }
      frame "Exit" {
        Variant To Data(type=no error, variant=w12) -> (data=w25, error out=w26)
        case (w26) {
          frame Error, Default {
            w14 = w13
          }
          frame No Error {
            # If exiting because of error, pass it on for display
            w14 = w25
          }
        }
        w15 = TRUE
        w16 = s1
      }
      frame "Error" {
        # Handle an error.  Here nothing is done, but it could be logged as an example
        Variant To Data(type=$Error_Type, variant=w12) -> (data=w14)
        w15 = default
        w16 = s1
      }
      frame "Result" {
        Variant To Data(error in (no error)=w13, type="ReadExecutable.gtype" constant, variant=w12) -> (data=w27, error out=w28)
        case (w28) {
          frame Error, Default {
            w14 = w28
            w16 = s1
          }
          frame No Error {
            call "Read Id.gvi"(Executable in=w27, Error in=w28) -> (Executable out=w29, Id=w30, Error out=w31)
            Array Index(array=s1) -> (out0[0]=w32)
            Is Equal(x=w30, y=w32) -> w33
            # If the message data contains a Read Executable, parse the result from it.
            case (w33) {
              frame False, Default {
                call "Parse Waveform from Result.gvi"(Read Executable In=w29, Error In=w31) -> (Waveform=w34, Error Out=w14)
                $Measurements <- w34
              }
              frame True {
                call "Parse Identity from Result.gvi"(Read Executable In=w29, Error In=w31) -> (Result=w35, Error Out=w14)
                $Identity <- w35
              }
            }
            w16 = s1
          }
        }
        w15 = default
      }
      frame "Done" {
        # Do nothing
        w14 = w13
        w15 = default
        w16 = s1
      }
    }
    call "Error Handling - Process Error.gvi"(Error to Process=w14, Exit on Error?=TRUE)
    next s1 = w16
    stop if w15
  }
  Register For Events("Stop"=w3) -> (event registration refnum out=w36)
  # Event loop: loops until Stop pressed or a Stop event raised.
  # Handles UI events by sending messages to the processing loop.
  while {
    event (dynamic events = w36) {
      on "Stop" Value changed; "Window" Close {
        Property Node(instance in="Event Data.gtype" {all zero or empty}, "Raiser Name"="Instrument Identification") -> (instance out=w39)
        # Stop button pressed. Raise Stop Event to halt further processing.
        Generate User Event(event data=w39, priority="high priority", user event=w3) -> (error out=w38)
        w37 = default
      }
      on dynamic event 0 {
        call "Enqueue Message.gvi"(Priority?=TRUE, Message Queue In=w6, Message Id="Stop") -> (Error Out=w38)
        # Stop event occurred.  Notify Main Processing Loop
        w37 = TRUE
      }
      on "Refresh" Value changed {
        # Refresh button pressed.  Notify Main Processing loop to rebuild resources
        call "Enqueue Message.gvi"(Message Queue In=w6, Message Id="Refresh") -> (Error Out=w38)
        w37 = default
      }
      on "Start" Value changed {
        # Get Measure button pressed.  Notify Main Processing Loop to take a measurement
        call "Enqueue Message.gvi"(Message Queue In=w6, Message Id="Get Measure") -> (Error Out=w38)
        w37 = default
      }
      on "Pause" Value changed {
        w40 = "All Internal Message Ids.gtype" {"Initialise"="Initialise", "Stop"="Stop", "Done"="Done", "Exit"="Exit", "Process"="Process", "Continue"="Continue", "Pause"="Pause", "Resume"="Resume"}
        Property Node(instance in=w40) -> ("Pause"=w41)
        # Pause event occurred.  Notify Main Processing Loop
        call "Enqueue Message.gvi"(Priority?=TRUE, Message Queue In=w6, Message Id=w41) -> (Error Out=w38)
        w37 = default
      }
      on "Resume" Value changed {
        w42 = "All Internal Message Ids.gtype" {"Initialise"="Initialise", "Stop"="Stop", "Done"="Done", "Exit"="Exit", "Process"="Process", "Continue"="Continue", "Pause"="Pause", "Resume"="Resume"}
        Property Node(instance in=w42) -> ("Resume"=w43)
        # Resume event occurred.  Notify Main Processing Loop
        call "Enqueue Message.gvi"(Priority?=TRUE, Message Queue In=w6, Message Id=w43) -> (Error Out=w38)
        w37 = default
      }
    }
    call "Error Handling - Process Error.gvi"(Error to Process=w38, Exit on Error?=FALSE)
    stop if w37
  }
  # Finally, deregister from events
  Unregister For Events(error in=w38, event registration refnum=w36) -> (error out=w44)
  # When Processing Errors,
  # the Main Loop will Exit as
  # the app may be in an unknown state.  The Event Loop will send an Error message to the Message Handler.
  Merge Errors(w44, w14) -> (error out=w45)
  $"Error Out" <- w45
