vi "Execute Write Read Query.gvi"   [LabVIEW NXG 5.0.0]
# Using the passed Executable, sends a command to the Instrument and reads the result.
inputs:
  "Read Executable In": "ReadExecutable.gtype"  # The Executable to use for the Query.
  "Driver in": "Driver.gtype"
  "Error in": error
outputs:
  "Raw Result": string  # The result returned from the Instrument without any processing.
  "Driver out": "Driver.gtype"
  "Error out": error
  "Read Executable Out": "ReadExecutable.gtype"  # The Executable post Query execution.
uses:
  Hardware Abstraction Framework::Common::Driver.gtype::Execute Write Query.gvi
  Hardware Abstraction Framework::Common::Driver.gtype::Read VISA Session.gvi
  Hardware Abstraction Framework::Common::ReadExecutable.gtype::Read Byte Count.gvi
  NI::VISA::Read (Instr, String).gvi
diagram:
  case ($"Error in") {
    frame No Error {
      call "Execute Write Query.gvi"(Driver in=$"Driver in", Executable In=$"Read Executable In", Error in=$"Error in") -> (Driver out=w5, Error out=w6)
      call "Read VISA Session.gvi"(Driver in=w5, Error in=w6) -> (Driver out=w2, VISA Session=w7, Error out=w8)
      call "Read Byte Count.gvi"(ReadExecutable in=$"Read Executable In") -> (ReadExecutable out=w4, Byte Count=w9)
      call "Read (Instr, String).gvi"(session in=w7, error in=w8, byte count=w9) -> (error out=w1, read buffer=w3)
    }
    frame Error {
      w1 = $"Error in"
      w2 = $"Driver in"
      w3 = default
      w4 = $"Read Executable In"
    }
  }
  $"Driver out" <- w2
  $"Error out" <- w1
  $"Raw Result" <- w3
  $"Read Executable Out" <- w4
