vi "Process Directors.gvi"   [LabVIEW NXG 5.0.0]
# Processes all Executable Directors until they complete.  This member will respond to events to Pause, Resume, and Stop.  Results will be notified on the Notification queue.
inputs:
  "Wait Time": u32  # The wait time, in milliseconds, between each Executable Director. Default is not to wait at all.
  "ExecutableProcessor in": "ExecutableProcessor.gtype", required
  "Error in": error
  "Results Notifier": Notifier<"ReadExecutable.gtype">  # Notifier for returning results to the Test Application.
outputs:
  "ExecutableProcessor out": "ExecutableProcessor.gtype"
  "Error out": error
types:
  "All Internal Message Ids.gtype" = cluster{"Initialise": string, "Stop": string, "Done": string, "Exit": string, "Process": string, "Continue": string, "Pause": string, "Resume": string}
  "All Notification Message Ids.gtype" = cluster{"Initialise": string, "Exit": string, "Error": string, "Result": string, "Done": string}
uses:
  Hardware Abstraction Framework::Support::Messages::Reset Message Queue.gvi
  Hardware Abstraction Framework::Support::Messages::Dequeue Message.gvi
  NI::G Core::Error::Build Error Cluster.gvi
  Hardware Abstraction Framework::Common::ExecutableDirector.gtype::Initialise.gvi
  Hardware Abstraction Framework::Support::Messages::Enqueue Message.gvi
  Hardware Abstraction Framework::Common::ExecutableDirector.gtype::Should Continue.gvi
  Hardware Abstraction Framework::Common::ExecutableDirector.gtype::Process Executables.gvi
  Hardware Abstraction Framework::Support::Events::Raise Done Event.gvi
  Hardware Abstraction Framework::Common::ExecutableDirector.gtype::Read Executables.gvi
  Hardware Abstraction Framework::Common::WriteExecutable.gtype::Cleanup.gvi
  Hardware Abstraction Framework::Support::Helpers::Error Handling - Process Error.gvi
diagram:
  w1 = "Hardware Abstraction Framework::Support::Resources.grsc::MessageQueues"
  Tag Read(ref in=w1) -> (Data=w2)
  # The Executable Processor will listen for Stop events to discontinue processing.  It using the Internal queue for framework messages and Notifications queue to send messages to the calling application (typically, results.)
  Property Node(instance in=w2) -> ("Internal"=w3, "Notifications"=w4)
  call "Reset Message Queue.gvi"(Message Queue In=w3) -> (Message Queue Out=w5)
  # Main Processing loop.  Waits for messages to appear on the queue and then processes it.  In many respects, it resembles a State Machine in that each processed message, adds another to the queue so that processing will continue in the next iteration.
  s1 = $"ExecutableProcessor in"  # shift register
  while {
    # Waits for next message. Queue is reset with Initialise message.
    call "Dequeue Message.gvi"(Message Queue In=w5, Error In=$"Error in") -> (Message Queue Out=w6, Message Id=w7, Message Data=w8, Error Out=w9)
    # Case options should include "All Internal Messages" as a minimum
    case (w7) {
      frame Default {
        w13 = "An unknown message - %s -was added to the notification queue"
        # An unknown message was added to the queue
        Format Into String(formatString=w13, w7) -> w14
        call "Build Error Cluster.gvi"(code=203, description=w14) -> (error out=w11)
        w10 = default
        w12 = s1
      }
      frame "Initialise" {
        w15 = "All Internal Message Ids.gtype" {"Initialise"="Initialise", "Stop"="Stop", "Done"="Done", "Exit"="Exit", "Process"="Process", "Continue"="Continue", "Pause"="Pause", "Resume"="Resume"}
        Property Node(instance in=w15) -> ("Process"=w16)
        Property Node(instance in=s1) -> ("Directors"=w17)
        # Initialises all Executable Directors
        for {
          w18 = each element of w17
          call "Initialise.gvi"(ExecutableDirector in=w18, Error in=w9) -> (Error out=w20)
          append w20 to w19
        }
        Merge Errors(w9, w19) -> (error out=w21)
        call "Enqueue Message.gvi"(Message Queue In=w6, Message Id=w16, Error In=w21) -> (Error Out=w11)
        w10 = default
        w12 = s1
      }
      frame "Process" {
        Property Node(instance in=s1) -> ("Directors"=w22)
        s2 = w22  # shift register
        for (iteration -> i1) {
          w23 = each element of w22
          call "Should Continue.gvi"(ExecutableDirector in=w23, Error in=w9) -> (ExecutableDirector out=w24, Should Continue?=w25, Error out=w26)
          # Should Continue? is checked here, as well as state "Continue" in case there are Directors that have completed before others - these shouldn't be processed.
          case (w25) {
            frame False, Default {
              # This particular Director has Done so do nothing.
              w27 = w26
              w28 = w24
            }
            frame True {
              call "Process Executables.gvi"(ExecutableDirector in=w24, Results Notifier=$"Results Notifier", Error in=w26) -> (ExecutableDirector out=w28, Error out=w27)
              Array Size(array=w22) -> (size(s)=w29)
              Decrement(x=w29) -> w30
              Is Equal(x=w30, y=i1) -> w31
              # Process each Executable Director in turn, once.  If it isn't the last, wait as requested before running the next one.
              case (w31) {
                frame False, Default {
                  Wait(time to wait=$"Wait Time")
                }
                frame True { }
              }
            }
          }
          Replace Array Subset(inArray=s2, index=i1, new=w28) -> w32
          next s2 = w32
        }
        w33 = "All Internal Message Ids.gtype" {"Initialise"="Initialise", "Stop"="Stop", "Done"="Done", "Exit"="Exit", "Process"="Process", "Continue"="Continue", "Pause"="Pause", "Resume"="Resume"}
        Property Node(instance in=w33) -> ("Continue"=w34)
        call "Enqueue Message.gvi"(Message Queue In=w6, Message Id=w34, Error In=w9) -> (Error Out=w35)
        Merge Errors(w35, w27) -> (error out=w11)
        # Because of NXG object processing by value, then changes to Executable Directors must be collected and written back to the Processor.
        Property Node(instance in=s1, "Directors"=s2) -> (instance out=w12)
        w10 = default
      }
      frame "Continue" {
        Property Node(instance in=s1) -> ("Directors"=w36)
        # Ask all Exectuable Directors if they should continue; when all respond false then we're done.  Any that are done will not get processed just because one or more are not yet finished.
        # An incoming stop message that occurs during processing will prevent this state executing as it will be 'higher' in the queue.  So a Stop message is only handled once all ED Executables have processed.
        s3 = FALSE  # shift register
        for {
          w37 = each element of w36
          call "Should Continue.gvi"(ExecutableDirector in=w37, Error in=w9) -> (Should Continue?=w39, Error out=w40)
          Logical Or(s3, w39) -> w41
          append w40 to w38
          next s3 = w41
        }
        Merge Errors(w9, w38) -> (error out=w42)
        w43 = "All Internal Message Ids.gtype" {"Initialise"="Initialise", "Stop"="Stop", "Done"="Done", "Exit"="Exit", "Process"="Process", "Continue"="Continue", "Pause"="Pause", "Resume"="Resume"}
        Property Node(instance in=w43) -> ("Process"=w44)
        w45 = "All Internal Message Ids.gtype" {"Initialise"="Initialise", "Stop"="Stop", "Done"="Done", "Exit"="Exit", "Process"="Process", "Continue"="Continue", "Pause"="Pause", "Resume"="Resume"}
        Property Node(instance in=w45) -> ("Done"=w46)
        Select(s=s3, t=w44, f=w46) -> w47
        call "Enqueue Message.gvi"(Message Queue In=w6, Message Id=w47, Error In=w42) -> (Error Out=w11)
        w10 = default
        w12 = s1
      }
      frame "Done" {
        w48 = "All Notification Message Ids.gtype" {"Initialise"="Initialise", "Exit"="Exit", "Error"="Error", "Result"="Result", "Done"="Done"}
        Property Node(instance in=w48) -> ("Done"=w49)
        # Need to signal the Done event so that the Framework starts the processing shutdown cleanly.  Adds a Done message to the Notification Queue so the application knows as well.
        call "Enqueue Message.gvi"(Message Queue In=w4, Message Id=w49, Error In=w9) -> (Error Out=w50)
        call "Raise Done Event.gvi"(Send Done?=TRUE, Raiser Name="Process Directors", Error In=w50) -> (Error Out=w51)
        w52 = "All Internal Message Ids.gtype" {"Initialise"="Initialise", "Stop"="Stop", "Done"="Done", "Exit"="Exit", "Process"="Process", "Continue"="Continue", "Pause"="Pause", "Resume"="Resume"}
        Property Node(instance in=w52) -> ("Stop"=w53)
        call "Enqueue Message.gvi"(Priority?=TRUE, Message Queue In=w6, Message Id=w53, Error In=w51) -> (Error Out=w11)
        w10 = default
        w12 = s1
      }
      frame "Pause" {
        # Clear the internal queue and wait for a Resume message to appear.  The queue is reset as Pause messages are raised at the front of the queue (high priority) and we don't want to process any messages that were in the queue originally.
        #
        # Note that the processing only pauses after the current run through of Executable Directors completes.
        call "Reset Message Queue.gvi"(Message Queue In=w6, Error In=w9) -> (Error Out=w11)
        w10 = default
        w12 = s1
      }
      frame "Resume" {
        w54 = "All Internal Message Ids.gtype" {"Initialise"="Initialise", "Stop"="Stop", "Done"="Done", "Exit"="Exit", "Process"="Process", "Continue"="Continue", "Pause"="Pause", "Resume"="Resume"}
        # On a Resume, continue processing.
        Property Node(instance in=w54) -> ("Continue"=w55)
        call "Enqueue Message.gvi"(Message Queue In=w6, Message Id=w55, Error In=w9) -> (Error Out=w11)
        w10 = default
        w12 = s1
      }
      frame "Stop" {
        w56 = "All Internal Message Ids.gtype" {"Initialise"="Initialise", "Stop"="Stop", "Done"="Done", "Exit"="Exit", "Process"="Process", "Continue"="Continue", "Pause"="Pause", "Resume"="Resume"}
        Property Node(instance in=w56) -> ("Exit"=w57)
        # Processing should Stop.  Send an Exit message to ensure clean shutdown.
        call "Enqueue Message.gvi"(Priority?=TRUE, Message Queue In=w6, Message Id=w57, Error In=w9) -> (Error Out=w11)
        w10 = default
        w12 = s1
      }
      frame "Exit" {
        Property Node(instance in=s1) -> ("Directors"=w58)
        # Processing will exit.  Ensure a clean shutdown.  All Executables are asked to cleanup which performs a controlled shutdown of Drivers.
        for {
          w59 = each element of w58
          call "Read Executables.gvi"(ExecutableDirector in=w59, Error in=w9) -> (Executables=w60, Error out=w61)
          for {
            w62 = each element of w60
            call "Cleanup.gvi"(WriteExecutable in=w62, Error in=w61) -> (Error out=w11)
          }
        }
        w10 = TRUE
        w12 = s1
      }
    }
    call "Error Handling - Process Error.gvi"(Error to Process=w11, Exit on Error?=TRUE)
    next s1 = w12
    stop if w10
  }
  w63 = "Hardware Abstraction Framework::Support::Resources.grsc::Events"
  Tag Read(ref in=w63) -> (Data=w64)
  Property Node(instance in=w64) -> ("Stop Event"=w65, "Done Event"=w66, "Pause Event"=w67, "Resume Event"=w68)
  # Listen for the named events raised by the framework or application.
  Register For Events("Stop"=w65, "Done"=w66, "Pause"=w67, "Resume"=w68) -> (event registration refnum out=w69)
  # Event loop: loops until Stop event raised.
  # When Processing Errors,
  # the Main Loop will Exit as
  # the app may be in an unknown state.  The Event Loop will send an Error message to the Message Handler.
  while {
    event (dynamic events = w69) {
      on dynamic event 0 {
        w72 = "All Internal Message Ids.gtype" {"Initialise"="Initialise", "Stop"="Stop", "Done"="Done", "Exit"="Exit", "Process"="Process", "Continue"="Continue", "Pause"="Pause", "Resume"="Resume"}
        Property Node(instance in=w72) -> ("Stop"=w73)
        call "Enqueue Message.gvi"(Priority?=TRUE, Message Queue In=w5, Message Id=w73) -> (Error Out=w71)
        # Stop event occurred.  Notify Main Processing Loop
        w70 = TRUE
      }
      on dynamic event 1 {
        # When Done is notified, then the event loop can stop.  Note that the Main Processing Loop is already stopping of its own accord and doesn't need notifying.  It also notifies the using application.
        w70 = TRUE
        w71 = default
      }
      on dynamic event 2 {
        w74 = "All Internal Message Ids.gtype" {"Initialise"="Initialise", "Stop"="Stop", "Done"="Done", "Exit"="Exit", "Process"="Process", "Continue"="Continue", "Pause"="Pause", "Resume"="Resume"}
        Property Node(instance in=w74) -> ("Pause"=w75)
        # Pause event occurred.  Notify Main Processing Loop
        call "Enqueue Message.gvi"(Priority?=TRUE, Message Queue In=w5, Message Id=w75) -> (Error Out=w71)
        w70 = default
      }
      on dynamic event 3 {
        w76 = "All Internal Message Ids.gtype" {"Initialise"="Initialise", "Stop"="Stop", "Done"="Done", "Exit"="Exit", "Process"="Process", "Continue"="Continue", "Pause"="Pause", "Resume"="Resume"}
        Property Node(instance in=w76) -> ("Resume"=w77)
        # Resume event occurred, notify Main Processing Loop
        call "Enqueue Message.gvi"(Priority?=TRUE, Message Queue In=w5, Message Id=w77) -> (Error Out=w71)
        w70 = default
      }
    }
    call "Error Handling - Process Error.gvi"(Error to Process=w71, Exit on Error?=FALSE)
    stop if w70
  }
  # Finally, deregister from events
  Unregister For Events(error in=w71, event registration refnum=w69) -> (error out=w78)
  Merge Errors(w78, w11) -> (error out=w79)
  $"Error out" <- w79
  $"ExecutableProcessor out" <- s1
