vi "Post Result.gvi"   [LabVIEW NXG 5.0.0]
# Posts the result (complete Executable with Raw Result set) onto the Notification Queue so that clients can pick it up and process it.
inputs:
  "ReadExecutable in": "ReadExecutable.gtype"
  "Error in": error
outputs:
  "ReadExecutable out": "ReadExecutable.gtype"
  "Error out": error
types:
  "All Notification Message Ids.gtype" = cluster{"Initialise": string, "Exit": string, "Error": string, "Result": string, "Done": string}
uses:
  Hardware Abstraction Framework::Support::Messages::Enqueue Message.gvi
diagram:
  case ($"Error in") {
    frame No Error {
      To Variant(anything=$"ReadExecutable in") -> w3
      w4 = "Hardware Abstraction Framework::Support::Resources.grsc::MessageQueues"
      Tag Read(ref in=w4) -> (Data=w5)
      Property Node(instance in=w5) -> ("Notifications"=w6)
      w7 = "All Notification Message Ids.gtype" {"Initialise"="Initialise", "Exit"="Exit", "Error"="Error", "Result"="Result", "Done"="Done"}
      Property Node(instance in=w7) -> ("Result"=w8)
      call "Enqueue Message.gvi"(Message Queue In=w6, Message Id=w8, Message Data=w3, Error In=$"Error in") -> (Error Out=w1)
      w2 = $"ReadExecutable in"
    }
    frame Error {
      w1 = $"Error in"
      w2 = $"ReadExecutable in"
    }
  }
  $"ReadExecutable out" <- w2
  $"Error out" <- w1
